% Simulink data dictionary EngineCtrl_V1_1_Global.sldd

EngineCtrl_Info_Bus = Simulink.Bus()  % エンジン制御情報出力信号バス
  EngCtrl_EngTrqDem: double, Unit="N*m"  % エンジントルク要求

EngineCtrl_Info_in_Bus = Simulink.Bus()  % エンジン制御例外処理用入力
  dummy: double  % ダミー信号

EngineCtrl_PwtrCAN_Rx_Bus = Simulink.Bus()  % エンジン制御 パワトレCAN入力信号バス
  HEVCtrl_Engine_torque_request: double, Unit="N*m"  % HEVエンジン要求トルク
  HEVCtrl_IdleStop_preparation_request: double  % HEV制御 アイドルストップ 準備要求
  HEVCtrl_IdleStop_request: double  % HEV制御 アイドルストップ要求
  HEVCtrl_IdleStop_status: double  % HEV制御 アイドルストップ状態

EngineCtrl_PwtrCAN_Tx_Bus = Simulink.Bus()  % エンジン制御 CAN出力信号バス
  EngCtrl_Engine_speed: double, Unit="rpm"  % エンジン制御 エンジン回転速度
  EngCtrl_Engine_torque_actual: double, Unit="N*m"  % エンジン制御 エンジン供給トルク