% Simulink data dictionary EngineCtrl_V1_1_Local.sldd
% references EngineCtrl_V1_1_Global.sldd

MassFuelCtrl_K3 = [0 10 0 0; 70 70 70 70]
MassFuelCtrl_K3x = [0 200 600 1000]
MassFuelCtrl_K3y = [0 400]

Config_Ctrl = Simulink.ConfigSet(StartTime="0", StopTime="10", FixedStep="0.01", Solver="FixedStepDiscrete", ProdHWDeviceType="32-bit Generic", SystemTargetFile="grt.tlc", TargetLang="C")  % 制御モデル用Configurationパラメータ
  % MILS用　固定ステップ　離散のみ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